# Grasshopper definition Spline_Wall_teaching-demo-EDI-NOTES.gh (Grasshopper 1.0.7)
# plug-ins: Biomorpher, Pufferfish

number_slider = Slider(12, range=5..20)
# ASSIGN YOUR CURVES FROM RHINO HERE BY RIGHT-CLICKING AND CHOOSE "SET MULTIPLE CURVES"
crv = Curve([<curve referenced from the Rhino model> x5])
range = Range(Domain=Domain(0, 1), Steps=number_slider)

twnconcrvs = TweenConsecutiveCurves(Curves=crv, Factor=range, Loopback=False, InterpolationType=0, Refit=0, PointSample=0)
# TO USE A CURVED SPLINE USE THE CURVE COMPONENT FROM THIS GROUP AND PLUG IT INTO THE CURVE COMPONENT ABOVE
crv_2 = Curve(twnconcrvs)
rebcrv = RebuildCurve(Curve=crv_2, Count=Slider(41, range=35..50), Degree=Slider(2, range=1..3), EndTangents=False)

twnconcrvs_2 = TweenConsecutiveCurves(Curves=crv, Factor=range, Loopback=False, InterpolationType=0, Refit=0, PointSample=0)
crv_3 = Curve(rebcrv)
flip = FlipCurve(Curve=twnconcrvs_2)  # -> Curve, Flag
# PLUG THE CURVE SPLINE COMPONENT HERE TO MAKE THE SWAP
crv_4 = Curve(graft(flip.Curve))
number_slider_2 = Slider(2.021, range=1..3)
# ADJUST THE DIMENSIONS OF THE SWEEP SECTION CURVE (RECTANGLE) HERE
number_slider_3 = Slider(0.75, range=0..1)
end = EndPoints(Curve=crv_4)  # -> Start, End
unit_y = UnitY(Factor=number_slider_2)
X = UnitX(Factor=number_slider_3)
pt = Point(end.End)
move = Move(Geometry=pt, Motion=X)  # -> Geometry, Transform
move_2 = Move(Geometry=pt, Motion=unit_y)  # -> Geometry, Transform
rec_3pt = Rectangle3Pt(PointA=pt, PointB=move_2.Geometry, PointC=move.Geometry)  # -> Rectangle, Length
genes = GenePool(
    Decimals=2,
    Maximum=2,
    Minimum=0.05,
    Value=[1.772046914, 1.616631394, 0.4530716929, 1.524222229, 0.250719064, 1.951415399])
# THIS IS THE COMPONENT YOU SHOULD BAKE TO BRING THE GEOMETRY INTO GRASSHOPPER
swp1 = Sweep1(Rail=crv_4, Sections=rec_3pt.Rectangle, Miter=1)
variance = Variance(num=genes)
# DOUBLE-CLICK TO LAUNCH
# 
# ALWAYS SAVE BEFORE RUNNING!!!
biomorpher = Biomorpher(Genome=[genes, number_slider_2, X, number_slider], Geometry=swp1, Performs=variance)

# ==== cluster Variance: Variance
num = ClusterInput()
num_2 = Number(num)
avr = Average(Input=num_2)
subtraction = Subtraction(A=avr, B=num_2)
lng = ListLength(List=num_2)
sqr = Square(Value=subtraction)
ma = MassAddition(Input=sqr)  # -> Result, PartialResults
division = Division(A=ma.Result, B=lng)
R = ClusterOutput(division)
