# Grasshopper definition Spline_Wall_teaching-demo-EDI.gh (Grasshopper 1.0.7)
# plug-ins: Biomorpher, Pufferfish, Bifocals

number_slider = Slider(10, range=5..20)
crv = Curve([<curve referenced from the Rhino model> x5])
range = Range(Domain=Domain(0, 1), Steps=number_slider)
twnconcrvs = TweenConsecutiveCurves(Curves=crv, Factor=range, Loopback=False, InterpolationType=0, Refit=0, PointSample=0)
twnconcrvs_2 = TweenConsecutiveCurves(Curves=crv, Factor=range, Loopback=False, InterpolationType=0, Refit=0, PointSample=0)
crv_2 = Curve(twnconcrvs)
flip = FlipCurve(Curve=twnconcrvs_2)  # -> Curve, Flag
rebcrv = RebuildCurve(Curve=crv_2, Count=Slider(41, range=35..50), Degree=Slider(2, range=1..3), EndTangents=False)
crv_3 = Curve(rebcrv)
crv_4 = Curve(graft(crv_3))
number_slider_2 = Slider(2.241, range=1..3)
end = EndPoints(Curve=crv_4)  # -> Start, End
unit_y = UnitY(Factor=number_slider_2)
X = UnitX(Factor=Slider(0.75, range=0..1))
pt = Point(end.End)
move = Move(Geometry=pt, Motion=X)  # -> Geometry, Transform
move_2 = Move(Geometry=pt, Motion=unit_y)  # -> Geometry, Transform
rec_3pt = Rectangle3Pt(PointA=pt, PointB=move_2.Geometry, PointC=move.Geometry)  # -> Rectangle, Length
genes = GenePool(
    Decimals=2,
    Maximum=2,
    Minimum=0.05,
    Value=[1.648183835, 0.4773057768, 1.738063684, 1.981104078, 1.235860306, 0.3685761951])
swp1 = Sweep1(Rail=crv_4, Sections=rec_3pt.Rectangle, Miter=1)
variance = Variance(num=genes)
biomorpher = Biomorpher(Genome=[genes, number_slider_2, X, number_slider], Geometry=swp1, Performs=variance)

# ==== cluster Variance: Variance
num = ClusterInput()
num_2 = Number(num)
avr = Average(Input=num_2)
subtraction = Subtraction(A=avr, B=num_2)
lng = ListLength(List=num_2)
sqr = Square(Value=subtraction)
ma = MassAddition(Input=sqr)  # -> Result, PartialResults
division = Division(A=ma.Result, B=lng)
R = ClusterOutput(division)
